# Grasshopper definition hw02-gauge.gh (Grasshopper 1.0.7)

# ----
# Main Rectangle
big_rectangle_height = Slider(2.5, range=0..3)
big_rectangle_width = Slider(1.8, range=0..5)
rectangle = Rectangle(Plane=PlaneXY(0, 0, 0), XSize=big_rectangle_width, YSize=big_rectangle_height, Radius=0)  # -> Rectangle, Length

# ----
# The NOTCH in the upper-left
notch_size = Slider(0.3, range=0..1)
subtraction = Subtraction(A=big_rectangle_height, B=notch_size)
rectangle_2 = Rectangle(Plane=PlaneXY(0, 0, 0), XSize=notch_size, YSize=notch_size, Radius=0)  # -> Rectangle, Length
Y = UnitY(Factor=subtraction)
move = Move(Geometry=rectangle_2.Rectangle, Motion=Y)  # -> Geometry, Transform

# ----
# Caliper Slot right edge, in the middle
# 2
caliper_slot = Slider(0.268, range=0..1)
slot_depth = Slider(0.497, range=0..1)
_2 = Number(2)
division = Division(A=big_rectangle_height, B=_2)
subtraction_2 = Subtraction(A=big_rectangle_width, B=slot_depth)
rectangle_3 = Rectangle(Plane=PlaneXY(0, 0, 0), XSize=slot_depth, YSize=caliper_slot, Radius=0)  # -> Rectangle, Length
vec = VectorXYZ(XComponent=subtraction_2, YComponent=division, ZComponent=0)  # -> Vector, Length
move_2 = Move(Geometry=rectangle_3.Rectangle, Motion=vec.Vector)  # -> Geometry, Transform

slot_position_delta = Slider(0.426, range=0..1)
slot_size_delta = Slider(0.033, range=0..1)
subtraction_3 = Subtraction(A=caliper_slot, B=slot_size_delta)
# 2
_2_2 = Number(2)
addition = Addition(A=division, B=slot_position_delta)
multiplication = Multiplication(A=slot_size_delta, B=_2_2)
rectangle_4 = Rectangle(Plane=PlaneXY(0, 0, 0), XSize=slot_depth, YSize=subtraction_3, Radius=0)  # -> Rectangle, Length
addition_2 = Addition(A=addition, B=slot_position_delta)
vec_2 = VectorXYZ(XComponent=subtraction_2, YComponent=addition, ZComponent=0)  # -> Vector, Length
subtraction_4 = Subtraction(A=caliper_slot, B=multiplication)
move_3 = Move(Geometry=rectangle_4.Rectangle, Motion=vec_2.Vector)  # -> Geometry, Transform
vec_3 = VectorXYZ(XComponent=subtraction_2, YComponent=addition_2, ZComponent=0)  # -> Vector, Length
rectangle_5 = Rectangle(Plane=PlaneXY(0, 0, 0), XSize=slot_depth, YSize=subtraction_4, Radius=0)  # -> Rectangle, Length
move_4 = Move(Geometry=rectangle_5.Rectangle, Motion=vec_3.Vector)  # -> Geometry, Transform
