# Grasshopper definition hw02-wing-01.gh (Grasshopper 1.0.7)

# ----
# MAIN INPUTS
airfoil_cardboard_thinkness = Slider(0.063, range=0..0.25)
spar_height = Slider(0.853, range=0..2)
airfoil_count = Slider(0, range=0..20)
wingspan = Slider(17, range=0..48)

spar_cardboard_thickness = Slider(0.243, range=0..1)

# ----
# Divide By Two
# 1/2 spar height
# 2
num = Number(2)
division = Division(A=spar_height, B=num)

# ----
# Cut a slot into the aifroil.  Depth should be the same as the spar slot depth (since we always use one-half spar thickness. Width should be spar thickness.
# AIRFOIL SLOT
# Airfoil Geometry
# Spar Slot Depth
# Spar Thickness
geo = Geometry(<curve referenced from the Rhino model>)
rectangle = Rectangle(Plane=PlaneXY(0, 0, 0), XSize=spar_cardboard_thickness, YSize=division, Radius=0)  # -> Rectangle, Length
rdiff = RegionDifference(CurvesA=geo, CurvesB=rectangle.Rectangle)

# ----
# SPAR SLOT
# Slot Depth
# Airfoil Cardboard Thickness
rectangle_2 = Rectangle(Plane=PlaneXY(0, 0, 0), XSize=airfoil_cardboard_thinkness, YSize=division, Radius=0)  # -> Rectangle, Length

# ----
# SPAR RECTANGLE (ROUNDED)
# Wingspan
# Spar Height
rectangle_3 = Rectangle(Plane=PlaneXY(0, 0, 0), XSize=wingspan, YSize=spar_height, Radius=spar_height)  # -> Rectangle, Length

# ----
# END AIRFOIL PLACEMENT
# Spar Slot
# Left Airfoil
# Wingspan
# Right Airfoil
# Offset from spar end
# 2
# 2
wingspan_fraction = Slider(0.019, range=0..0.25)
multiplication = Multiplication(A=wingspan, B=wingspan_fraction)
num_2 = Number(2)
X = UnitX(Factor=multiplication)
multiplication_2 = Multiplication(A=multiplication, B=num_2)
move = Move(Geometry=rectangle_2.Rectangle, Motion=X)  # -> Geometry, Transform
subtraction = Subtraction(A=wingspan, B=multiplication_2)
X_2 = UnitX(Factor=subtraction)
arrlinear = LinearArray(Geometry=move.Geometry, Direction=X_2, Count=num_2)  # -> Geometry, Transform

# ----
# MIDDLE AIRFOIL PLACMENT
# Center Airfoil
# Spar Slot
# Take half the spar lengh (i.e. wingspan)
# Spar Length
# 2
# Slot Width
# Subtract half the slot thinkness
num_3 = Number(2)
division_2 = Division(A=wingspan, B=num_3)
division_3 = Division(A=airfoil_cardboard_thinkness, B=num_3)
subtraction_2 = Subtraction(A=division_2, B=division_3)
X_3 = UnitX(Factor=subtraction_2)
move_2 = Move(Geometry=rectangle_2.Rectangle, Motion=X_3)  # -> Geometry, Transform

# ----
# CALCULATE AIRFOIL SPACING
# Wing Span
# Spar Count
relay = Relay()
relay_2 = Relay()
integer_division = IntegerDivision(A=relay, B=relay_2)

# ----
# REPLICATE SPAR SLOTS
# Spar Slot
# Spar Spacing
# Spar Count
relay_3 = Relay()
relay_4 = Relay()
relay_5 = Relay()
X_4 = UnitX(Factor=relay_4)
arrlinear_2 = LinearArray(Geometry=relay_5, Direction=X_4, Count=relay_3)  # -> Geometry, Transform

# ----
# FINAL OUTPUT
merge = Merge(Data2=move_2.Geometry, Data3=move.Geometry, Data4=arrlinear.Geometry)
rdiff_2 = RegionDifference(CurvesA=rectangle_3.Rectangle, CurvesB=merge)
fillet = Slider(0.049, range=0..0.2)
fillet_2 = Fillet(Curve=rdiff_2, Radius=fillet)
